# Dynamo graph GetBlocks.dyn (Dynamo 2.12.0.5650)

currentDoc = nanoCAD.Init.CurrentDoc()
getAllBlocks = nanoCAD.DynBlocks.General.GetAllBlocks(aux=currentDoc)
getInfo = nanoCAD.DynBlocks.AcadBlock.GetInfo(aux=currentDoc, com_block=getAllBlocks)
