# Dynamo graph InsertText.dyn (Dynamo 2.12.1.8246)

application = DynNCAD.Project.Application.Application()
NDocument = DynNCAD.Project.NDocument.NDocument(ncad_app=application)
modelSpace = DynNCAD.Project.NDocument.ModelSpace(nDocument=NDocument)
code_block = CodeBlock { "test"; 3.0; }
code_block_2 = CodeBlock { 0.0; 100.0; }
byCoordinates = Point.ByCoordinates(x=code_block_2.out0, y=code_block_2.out1, z=code_block_2.out0)
addText = DynNCAD.Project.Block.AddText(block=modelSpace, Text=code_block.out0, insetion_point=byCoordinates, text_height=code_block.out1)
