# Dynamo graph Test_getObjects.dyn (Dynamo 2.12.1.8246)

application = DynNCAD.Project.Application.Application()
NDocument = DynNCAD.Project.NDocument.NDocument(ncad_app=application)
modelSpace = DynNCAD.Project.NDocument.ModelSpace(nDocument=NDocument)
name = DynNCAD.Project.Block.Name(block=modelSpace)
code_block = CodeBlock { null; }
getSelectedObjectsInDrawing = DynNCAD.Project.Selection.GetSelectedObjectsInDrawing(NDocument=NDocument, classes_names=code_block)
objectID = DynNCAD.Objects.AcadEntity.ObjectID(acadEntity=getSelectedObjectsInDrawing)
autoCADObjectsClasses = DynNCAD.Project.Selection.AutoCADObjectsClasses()
list_create = List.Create(item0=autoCADObjectsClasses.Текст)
asCOM_object = DynNCAD.Objects.AcadEntity.AsCOM_object(acadEntity=getSelectedObjectsInDrawing)  # frozen
text = DynNCAD.Objects.Annotation.Text.Text(model_object=asCOM_object)
height = DynNCAD.Objects.Annotation.Text.Height(text=text)
textString = DynNCAD.Objects.Annotation.Text.TextString(text=text)
objectName = DynNCAD.Objects.AcadEntity.ObjectName(acadEntity=getSelectedObjectsInDrawing)
uniqueItems = List.UniqueItems(list=objectName)
подсчет_числа_элементов_классов = Python(IN[0]=objectName, IN[1]=uniqueItems)  # CPython3
# ---------- подсчет_числа_элементов_классов.python (6 lines) ----------
source_list = IN[0]
uniq_values = IN[1]
out_data = dict()
for uniq in uniq_values:
	out_data[uniq] = source_list.count(uniq)
OUT = out_data
# ----------------------------------------
