# Dynamo graph demo_Создание геометрии.dyn (Dynamo 2.12.1.8246)

# group: Разворот созданного текста
code_block = CodeBlock { 30; }

# group: Получение документа
application = DynNCAD.NanoCAD.Application.Application()
document = DynNCAD.NanoCAD.Document.Document(Application=application)

# group: Получение пространства модели
acadDatabase = DynNCAD.AcadDatabase.AcadDatabase(Document=document)
modelSpace = DynNCAD.AcadDatabase.ModelSpace(acadDatabase=acadDatabase)

# group: Параметры создания текста
code_block_2 = CodeBlock { Point.ByCoordinates(205.7285, 214.9553, 0); }
code_block_3 = CodeBlock { "Это ванная"; 3; }
acadText = DynNCAD.AcadObjects.AcadEntities.AcadText.AcadText(block=modelSpace, insetion_point=code_block_2, text_height=code_block_3.out1, text=code_block_3.out0)

rotation = DynNCAD.AcadObjects.AcadEntities.AcadText.Rotation(acadText=acadText)
